# Grasshopper definition rhino_gh_runner.gh (Grasshopper 1.0.8)

python_3_script = Python3Script()  # -> out, a
# ---------- python_3_script: Python ----------
import sys
import importlib

REPO = r"C:\Users\22615\OneDrive - Gensler\_MyPython\rhino_gh"

if REPO not in sys.path:
    sys.path.insert(0, REPO)

import gh_loader
importlib.reload(gh_loader)

if run:
    a, log = gh_loader.run_command(command)
else:
    a = None
    log = "Waiting..."
# ---------- end python_3_script ----------
panel = Panel(python_3_script.out)
